# Grasshopper definition LL97_GH_Snippits.gh (Grasshopper 1.0.8)

cluster = Cluster()
building_material = ValueList({"Steel frame": "SteelFramed", "Mass / concrete": "Mass", "Wood frame": "WoodFramed", "Metal building": "MetalBuilding"}, selected="Mass / concrete")
list = ValueList({"Office_pre1980", "Office_1980_2004", "Office_2004_2013", "MF_midrise_pre1980", "MF_midrise_1980_2004", "MF_midrise_2004_2013", "OfficeRetail_pre1980", "OfficeRetail_1980_2004"}, selected="MF_midrise_1980_2004")
list_2 = ValueList({"Office (B)": "B", "Multifamily (MF)": "MF"}, selected="Office (B)")
brep_building_mass = Brep(<brep referenced from the Rhino model>)
list_3 = ValueList({"2024-2029": "2024_2029", "2030-2034": "2030_2034"}, selected="2024-2029")
searchprog = HBSearchPrograms()  # -> room_prog; plug-in component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
cluster_1 = Cluster1(geo=brep_building_mass, preset=list, material=building_material)  # -> eui_end_use, end_uses, toggle_3, gross_floor
# CLUSTER ONE : FROM BUILDING GEOMETRY TO ANNUAL ENERGY
# CLUSTER TWO : FROM ENERGY TO CARBON EMISSION
# CLUSTER THREE : LL97 ENGINE
cluster_2 = Cluster2(vals=cluster_1.eui_end_use, names=cluster_1.end_uses, area=cluster_1.gross_floor, ip=cluster_1.toggle_3)
cluster_3 = Cluster3(num_gfa_gross_floor_area=cluster_1.gross_floor, g=list_2, y=list_3, em_tco2=cluster_2)  # -> cap, diff, fine, status
panel = Panel(searchprog)

# ---- group: OUPUT
status = Panel(cluster_3.status)
diff_emission_gap = Panel(cluster_3.diff)
fine = Panel(cluster_3.fine)
cap_total = Panel(cluster_3.cap)

# ----
searchconstrset = HBSearchConstructionSets()  # -> constr_sets; plug-in component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
panel_2 = Panel(searchconstrset)

# ==== cluster Cluster1
geo = ClusterInput()
preset = ClusterInput()
material = ClusterInput()
roomsolid = HBRoomFromSolid(geo=flatten(geo), conditioned=True)  # -> report, rooms; plug-in component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
py3_conversion_tool = Python3Script(preset=preset, material=material)  # -> out, HB_ProgramName, HB_ConstrName, LL97_Group; inputs preset: String, material: String
# ---------- py3_conversion_tool: Python ----------
"""
Inputs:
    preset   : key from preset value list (e.g. "Office_2004_2013")
    material : key from material value list (e.g. "SteelFramed", "Mass")
Outputs:
    HB_ProgramName : e.g. "1980_2004::MediumOffice::ClosedOffice"
    HB_ConstrName  : e.g. "1980_2004::ClimateZone4::SteelFramed"
    LL97_Group     : e.g. "B", "MF"
"""

# ---- PRESET TABLE (what type of building + vintage) ----

PRESETS = {
    # OFFICE (LL97 Group B)
    "Office_pre1980": {
        "Vintage": "pre_1980",
        "ProgramCore": "MediumOffice::ClosedOffice",
        "LL97_Group": "B"
    },
    "Office_1980_2004": {
        "Vintage": "1980_2004",
        "ProgramCore": "MediumOffice::ClosedOffice",
        "LL97_Group": "B"
    },
    "Office_2004_2013": {
        # for now, use 1980_2004 performance as a proxy
        "Vintage": "1980_2004",
        "ProgramCore": "MediumOffice::ClosedOffice",
        "LL97_Group": "B"
    },

    # MIDRISE MULTIFAMILY (LL97 Group MF)
    "MF_midrise_pre1980": {
        "Vintage": "pre_1980",
        "ProgramCore": "MidriseApartment::Apartment",
        "LL97_Group": "MF"
    },
    "MF_midrise_1980_2004": {
        "Vintage": "1980_2004",
        "ProgramCore": "MidriseApartment::Apartment",
        "LL97_Group": "MF"
    },
    "MF_midrise_2004_2013": {
        "Vintage": "1980_2004",
        "ProgramCore": "MidriseApartment::Apartment",
        "LL97_Group": "MF"
    },

    # OFFICE + RETAIL MIX (still LL97 Group B)
    "OfficeRetail_pre1980": {
        "Vintage": "pre_1980",
        "ProgramCore": "MediumOffice::OpenOffice",
        "LL97_Group": "B"
    },
    "OfficeRetail_1980_2004": {
        "Vintage": "1980_2004",
        "ProgramCore": "MediumOffice::OpenOffice",
        "LL97_Group": "B"
    }
}

# ---- MATERIAL / STRUCTURE MAP (what goes into the HB name) ----

MATERIAL_MAP = {
    None          : "SteelFramed",   # default if nothing is connected
    "":            "SteelFramed",
    "SteelFramed": "SteelFramed",
    "Mass":        "Mass",
    "WoodFramed":  "WoodFramed",
    "MetalBuilding": "MetalBuilding"
}

# ----------------------------------------------------------------

data = PRESETS.get(preset, None)

if data is None:
    HB_ProgramName = None
    HB_ConstrName  = None
    LL97_Group     = None
else:
    vintage = data["Vintage"]
    prog_core = data["ProgramCore"]
    LL97_Group = data["LL97_Group"]

    # full program name with vintage prefix
    HB_ProgramName = "{}::{}".format(vintage, prog_core)

    # pick a construction-set material
    mat_key = MATERIAL_MAP.get(material, "SteelFramed")

    # NYC ~ ASHRAE ClimateZone4
    HB_ConstrName = "{}::ClimateZone4::{}".format(vintage, mat_key)
# ---------- end py3_conversion_tool ----------
panel = Panel(py3_conversion_tool.HB_ConstrName)
panel_2 = Panel(py3_conversion_tool.HB_ProgramName)
panel_3 = Panel(py3_conversion_tool.LL97_Group)
model = HBModel(rooms=flatten(roomsolid.rooms))  # -> report, model; plug-in component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
applyprogram = HBApplyProgramType(rooms=flatten(roomsolid.rooms), program=py3_conversion_tool.HB_ProgramName)  # -> report, rooms; plug-in component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
applyconstrset = HBApplyConstructionSet(rooms=roomsolid.rooms, constr_set=py3_conversion_tool.HB_ConstrName)  # -> rooms; plug-in component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
new_york_epw_weather_file = Panel("https://climate.onebuilding.org/WMO_Region_4_North_and_Central_America/USA_United_States_of_America/NY_New_York/USA_NY_New.York-Central.Park.Observatory-Belvedere.Castle.725053_TMY3.zip")

toggle = BooleanToggle(True)

downloadepw = LBDownloadWeather(weather_URL=new_york_epw_weather_file)  # -> epw_file, stat_file, ddy_file; plug-in component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
modeltoosm = HBModelToOSM(model=model.model, epw_file=downloadepw.epw_file, write=Toggle(True))  # -> report, jsons, osw, osm, idf, sql, zsz, rdd, html; plug-in component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
runosm = HBRunOSM(osm=modeltoosm.osm, epw_file=downloadepw.epw_file, translate=toggle, run=toggle)  # -> report, idf, sql, zsz, rdd, html; plug-in component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
toggle_2 = BooleanToggle(False)
toggle_3 = ClusterOutput(toggle_2)
eui = HBEndUseIntensity(sql=runosm.sql, ip=toggle_2)  # -> eui, eui_end_use, end_uses, gross_floor; plug-in component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
gross_floor_area = Panel(eui.gross_floor)
eui_end_use = ClusterOutput(eui.eui_end_use)
end_uses = ClusterOutput(eui.end_uses)
gross_floor = ClusterOutput(eui.gross_floor)
panel_4 = Panel(eui.eui_end_use)
panel_5 = Panel(eui.end_uses)

# ==== cluster Cluster

# ==== cluster Cluster2
vals = ClusterInput()
names = ClusterInput()
area = ClusterInput()
ip = ClusterInput()
py3_extract_energy_type = Python3Script(vals=vals, names=names, area=area, ip=ip)  # -> out, elec_kwh, gas_kwh, other_kwh, debug; inputs vals: list of Double, names: list of String, area: Double, ip: Boolean
# ---------- py3_extract_energy_type: Python ----------
"""
Inputs
    vals  : list of EUI per end use (from eui_end_use)
    names : list of end-use labels (from end_uses)
    area  : gross floor area (m2 if ip=False, ft2 if ip=True)
    ip    : True = IP (kBtu/ft2), False = SI (kWh/m2)

Outputs
    elec_kwh : total annual electricity use [kWh]
    gas_kwh  : total annual gas use [kWh]
    other_kwh: everything else [kWh]
    debug    : list of (name, energy_kwh) tuples
"""

# safety
if not vals or not names:
    elec_kwh = gas_kwh = other_kwh = 0.0
    debug = ["No data"]
else:
    elec_kwh = 0.0
    gas_kwh = 0.0
    other_kwh = 0.0
    debug = []

    # factor for IP → kWh
    KBTU_PER_KWH = 3.412

    for v, n in zip(vals, names):
        if v is None:
            continue

        # convert intensity → annual kWh
        if ip:  # IP: kBtu/ft2
            # total kBtu = v * area(ft2); then /3.412 → kWh
            energy_kwh = (v * area) / KBTU_PER_KWH
        else:   # SI: kWh/m2
            energy_kwh = v * area

        name_low = str(n).lower()

        # very simple mapping: heating = gas, everything else = electric
        if "heating" in name_low:
            gas_kwh += energy_kwh
        elif any(key in name_low for key in
                 ["cooling", "lighting", "electric", "equipment", "fans", "pumps"]):
            elec_kwh += energy_kwh
        else:
            other_kwh += energy_kwh

        debug.append("{} → {:.1f} kWh".format(n, energy_kwh))
# ---------- end py3_extract_energy_type ----------
panel = Panel(py3_extract_energy_type.gas_kwh)
panel_2 = Panel(py3_extract_energy_type.elec_kwh)
py3_energy_to_carbon_emission = Python3Script(E_kWh=py3_extract_energy_type.elec_kwh, G_kWh=py3_extract_energy_type.gas_kwh)  # -> out, Em_tCO2; inputs E_kWh: Int32, G_kWh: Int32
# ---------- py3_energy_to_carbon_emission: Python ----------
"""
Inputs:
    E_kWh: Annual electricity consumption [kWh]
    G_kWh: Annual gas consumption [kWh] OR 0 if not used
Outputs:
    Em_tCO2: Total annual emissions [tCO2e/yr]
"""

# --- Emission factors (Phase 1 prototype values) ---
EF_ELEC = 0.0003    # tCO2e per kWh of electricity
EF_GAS  = 0.0002    # tCO2e per kWh of gas (example)

if E_kWh is None:
    E_kWh = 0.0

if G_kWh is None:
    G_kWh = 0.0

Em_tCO2 = E_kWh * EF_ELEC + G_kWh * EF_GAS
# ---------- end py3_energy_to_carbon_emission ----------
em_tco2 = ClusterOutput(py3_energy_to_carbon_emission.Em_tCO2)

# ==== cluster Cluster3
num_gfa_gross_floor_area = ClusterInput()
g = ClusterInput()
y = ClusterInput()
em_tco2 = ClusterInput()

num_gfa_gross_floor_area_2 = Number(num_gfa_gross_floor_area)
py3 = Python3Script(GFA=num_gfa_gross_floor_area_2, g=g, y=y, Em_tCO2=em_tco2)  # -> out, Cap, Diff, Fine, Status
# ---------- py3: Python ----------
"""
Inputs:
    GFA: Gross floor area [ft2]
    g: Building Group ID (e.g. "B", "MF")
    y: Year band (e.g. "2024_2029", "2030_2034")
    Em_tCO2: Annual emissions [tCO2e/yr]
Outputs:
    Cap: LL97 cap [tCO2e/yr]
    Diff: Em_tCO2 - Cap [tCO2e/yr]
    Fine: Annual fine [$ / yr]
    Status: "PASS" / "AT RISK" / "FAIL"
"""

# ----- Phase 1 caps table (tCO2e / ft2 / yr) -----
CAPS = {
    "B": {  # Office/Mercantile
        "2024_2029": 0.00846,
        "2030_2034": 0.00453
    },
    "MF": {  # Multifamily
        "2024_2029": 0.00675,
        "2030_2034": 0.00313
    }
}

if GFA is None:
    GFA = 0.0

if Em_tCO2 is None:
    Em_tCO2 = 0.0

# Get per-sf cap
group_caps = CAPS.get(g, None)
if group_caps is None:
    Cap = None
    Diff = None
    Fine = None
    Status = "UNKNOWN GROUP"
else:
    per_sf = group_caps.get(y, None)
    if per_sf is None:
        Cap = None
        Diff = None
        Fine = None
        Status = "UNKNOWN YEARBAND"
    else:
        Cap = per_sf * GFA
        Diff = Em_tCO2 - Cap

        # Fine at $268 per tCO2e above cap
        overage = max(0.0, Diff)
        Fine = overage * 268.0

        # Status logic
        if Diff <= 0:
            Status = "PASS"
        elif Diff <= 0.1 * Cap:
            Status = "AT RISK"
        else:
            Status = "FAIL"
# ---------- end py3 ----------

cap = ClusterOutput(py3.Cap)
diff = ClusterOutput(py3.Diff)
fine = ClusterOutput(py3.Fine)
status = ClusterOutput(py3.Status)
